# Dynamo custom node PlaceViewsOnSheets.dyf "Tool.PlaceViewsOnSheets" (Dynamo 2.6.1.8786)
# category: SteamNodes.Tool
# Places existing views on existing sheets

python_script = Python()  # unwired: IN[0], IN[1], IN[2]
# ---------- python_script.python (50 lines) ----------
#python nodes in dynamo 1.2
#proposed by Julien Benoit @jbenoit44 
#http://aecuandme.wordpress.com/
import clr
clr.AddReference('ProtoGeometry')
from Autodesk.DesignScript.Geometry import *
# Import ToDSType(bool) extension method
clr.AddReference("RevitNodes")
import Revit
clr.ImportExtensions(Revit.Elements)
# Import geometry conversion extension methods
clr.ImportExtensions(Revit.GeometryConversion)
# Import DocumentManager and TransactionManager
clr.AddReference("RevitServices")
import RevitServices
from RevitServices.Persistence import DocumentManager
from RevitServices.Transactions import TransactionManager
from System.Collections.Generic import *
# Import RevitAPI
clr.AddReference("RevitAPI")
import Autodesk
from Autodesk.Revit.DB import *

doc = DocumentManager.Instance.CurrentDBDocument
uiapp = DocumentManager.Instance.CurrentUIApplication
app = uiapp.Application
uidoc=DocumentManager.Instance.CurrentUIApplication.ActiveUIDocument

sheets = []
for i in IN[0]:
	sheets.append(UnwrapElement(i))
views=[]	
for i in IN[1]:
	views.append(UnwrapElement(i))
points=[]	
for i in IN[2]:
	points.append(UnwrapElement(i).ToXyz())

# Start Transaction
TransactionManager.Instance.EnsureInTransaction(doc)
viewp=[]
#for sheet,view,point in zip(sheets,views,points):
for s,v,p in zip(sheets,views,points):
	a=Viewport.Create(doc, s.Id,v.Id, p)
	viewp.append(a)

# End Transaction
TransactionManager.Instance.TransactionTaskDone()

OUT=viewp
# ----------------------------------------
SheetList = Input(SheetList: var[])
ViewsList = Input(ViewsList: var[])
PointsList = Input(PointsList: var[])
v2 = Python(IN[0]=SheetList, IN[1]=ViewsList, IN[2]=PointsList)
# ---------- v2.python (50 lines) ----------
#python nodes in dynamo 1.2
#proposed by Julien Benoit @jbenoit44 
#http://aecuandme.wordpress.com/
import clr
clr.AddReference('ProtoGeometry')
from Autodesk.DesignScript.Geometry import *
# Import ToDSType(bool) extension method
clr.AddReference("RevitNodes")
import Revit
clr.ImportExtensions(Revit.Elements)
# Import geometry conversion extension methods
clr.ImportExtensions(Revit.GeometryConversion)
# Import DocumentManager and TransactionManager
clr.AddReference("RevitServices")
import RevitServices
from RevitServices.Persistence import DocumentManager
from RevitServices.Transactions import TransactionManager
from System.Collections.Generic import *
# Import RevitAPI
clr.AddReference("RevitAPI")
import Autodesk
from Autodesk.Revit.DB import *

doc = DocumentManager.Instance.CurrentDBDocument
uiapp = DocumentManager.Instance.CurrentUIApplication
app = uiapp.Application
uidoc=DocumentManager.Instance.CurrentUIApplication.ActiveUIDocument

sheets = []
for i in IN[0]:
	sheets.append(UnwrapElement(i))
views=[]	
for i in IN[1]:
	views.append(UnwrapElement(i))
points=[]	
for i in IN[2]:
	points.append(UnwrapElement(i).ToXyz())

# Start Transaction
TransactionManager.Instance.EnsureInTransaction(doc)
viewp=[]
for s in sheets:
	for v,p in zip(views,points):
		a=Viewport.Create(doc, s.Id,v.Id, p)
		viewp.append(a)

# End Transaction
TransactionManager.Instance.TransactionTaskDone()

OUT=viewp
# ----------------------------------------
Viewports = Output(v2)
Input = Input(: var[]..[])
